# Grasshopper definition S2-intro-to-graphs.gh (Grasshopper 1.0.8)
# plug-ins: ShapeDiverForGrasshopper

list = ValueList({"graphs-01-intro": 0, "graphs-02-graph-from-mesh": 1, "graphs-03-with-data": 2, "graphs-04-dual-graph": 3, "graphs-05-shorest-paths": 4}, selected="graphs-05-shorest-paths")
graphs_02_graph_from_mesh = FilePath("D:\MPDA 25\Semester 02\Programming\Class 02\Class 02 _Files\graphs\graphs-02-graph-from-mesh.py")
graphs_05_shorest_paths = FilePath("D:\000 MPDA\PYTHOOON\Session 03\MPDA25-Assignment3\graphs\graphs-05-shorest-paths.py")
graphs_04_dual_graph = FilePath("D:\MPDA 25\Semester 02\Programming\Class 02\Class 02 _Files\graphs\graphs-04-dual-graph.py")
graphs_03_with_data = FilePath("D:\MPDA 25\Semester 02\Programming\Class 02\Class 02 _Files\graphs\graphs-03-with-data.py")
graphs_01_intro = FilePath("D:\MPDA 25\Semester 02\Programming\Class 02\Class 02 _Files\graphs\graphs-01-intro.py")
number_slider = Slider(2, range=0..10)
sddp = ShapeDiverDocumentPayload({AbsoluteTolerance=0, AngleTolerance=0, DistanceDisplayPrecision=0, GltfVersion="Gltf2", GrasshopperVersion="1.0.0008", InputGroups="{}", OutputGroups="{}", RelativeTolerance=0, RhinoVersion="8.16.25042.13001", UnitSystem=0, VersionCreated="1.23.0.0", VersionSaved="1.24.1.0"})
filter = StreamFilter(
    Gate=list,
    Stream0=graphs_01_intro,
    Stream1=graphs_02_graph_from_mesh,
    Stream2=graphs_03_with_data,
    Stream3=graphs_04_dual_graph,
    Stream4=graphs_05_shorest_paths)
mplane = MeshPlane(
    Boundary={Plane=PlaneXY(0, 0, 0), Size=Domain2(u=-10..10, v=-10..10)},
    WidthCount=number_slider,
    HeightCount=number_slider)  # -> Mesh, Area
quadmesh = Mesh(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)
panel = Panel(filter)
trimesh = Mesh(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)
mesh = Mesh(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)
file = ReadFile(File=filter, PerLineParse=False)
number_slider_2 = Slider(4, range=0..10)
preview = CustomPreview(
    Geometry=mesh,
    Material={diffuse=RGB(221, 160, 221), emission=RGB(66, 48, 66), shine=0.5, specular=RGB(255, 255, 255), transparency=0})
demesh = DeconstructMesh(Mesh=mesh)  # -> Vertices, Faces, Colours, Normals
py3 = Python3Script(script=file, m=mesh, s=Slider(0, range=0..100), t=Slider(79, range=0..100))  # -> out, a, b, c; inputs m: Mesh, s: Int32, t: Int32; unedited script template
conmesh = ConstructMesh(Vertices=demesh.Vertices, Faces=graft(demesh.Faces))  # -> flatten(Mesh)
points = PointList(Points=py3.a)
# Networkx.org
item = ListItem(List=conmesh, Index=py3.c, Wrap=True)
